# Requirement set SystemRequirements (R2023a)

Attributes:
- Applicable Spec: Imported from Excel:Applicable Spec
- Category: Imported from Excel:Category
- Derived: Imported from Excel:Derived
- Design Assurance Level: Imported from Excel:Design Assurance Level
- Safety Related: Imported from Excel:Safety Related
- Verification Method: Imported from Excel:Verification Method

## 1 [SystemRequirements!Sheet1] References to SystemRequirements.xlsx (Sheet1) (Container)
Imported from Microsoft Excel

### 1.1 [Sheet1!SN-01] Coverage (Informational)
The minidrone must be able to also cover big crop fields.
Category: Stakeholder needs

### 1.2 [Sheet1!SN-02] Scaring birds (Informational)
The minidrone must scare birds away from crop fields.
Category: Stakeholder needs

### 1.3 [Sheet1!FR-01] Take off and land
The quadcopter shall have a maximum angular velocity of at least 180 deg/s.
Category: Functional requirements

### 1.4 [Sheet1!FR-02] Perform controlled flight
The minidrone should be able to fly according to a six degrees of freedom (6 DOF) movement.
Category: Functional requirements

### 1.5 [Sheet1!FR-03] Flight range
The range of the minidrone must be at least 10 kilometers, so that it can also cover larger crop fields.
Category: Functional requirements

### 1.6 [Sheet1!FR-05] Flight control
The flight of the drone should be managed from a control system and should operate autonomously so it can fly a predetermined route over a crop field.
Category: Functional requirements

### 1.7 [Sheet1!FR-06] Scaring mechanism
The drone should be able to make a high pitch sound to scare birds away.
Category: Functional requirements

### 1.8 [Sheet1!HR-01] Body
The main body protects the other components and also provides structural support. A microphone may be attached to it in order to produce a high pitch sound to scare birds away.
Category: Hardware requirements

### 1.9 [Sheet1!HR-02] Power module
The power module will need to provide enough power to support the propulsion system, flight control and communication modules.
Category: Hardware requirements

### 1.10 [Sheet1!HR-03] Propulsion module
The propulsion module consists of one or more rotor assemblies that contain a propeller and a motor driving the propeller.
Category: Hardware requirements

### 1.11 [Sheet1!HR-04] Flight control module
The flight control module consists of a control system module and a path planning module.
Category: Hardware requirements

### 1.12 [Sheet1!HR-05] Control system
The control system module controls the behavior of the minidrone while in flight.
Category: Hardware requirements

### 1.13 [Sheet1!HR-06] Path planning
The system should be able to plan its own path and update it based on user requests or outside factors.
Category: Hardware requirements

### 1.14 [Sheet1!HR-07] Noise module
The minidrone should have a speaker or other sensor to make it possible to produce a high pitch sound to scare birds away.
Category: Hardware requirements

### 1.15 [Sheet1!HR-08] Sensor module
The minidrone should have a redundant IMU for improved calibration and pose estimation and encoder sensors to measure velocity of propeller motors to use as an input to the flight control modules.
Category: Hardware requirements

### 1.16 [Sheet1!HR-09] Communication module
The minidrone must have Wi-Fi network communication and/or radio/Bluetooth communication.
Category: Hardware requirements

### 1.17 [Sheet1!FR-04] Flight region
For testing purposes, the drone should be able to achieve and maintain a constant altitude of 1,5 meters.
Category: Functional requirements